test file "Dialysis-Machine-Simulink"
  coverage: Decision

suite "UFR_Controller"

  case "UFR_Controller_TestSeq_Harness" [baseline]
    model UFR_Controller, harness UFR_Controller_TestSeq_Harness
    test sequence scenario: Constant_UFR (UFR_Controller_TestSeq_Harness/Test Sequence)
    iterations:
      Iteration1: TestSequenceScenario "Constant_UFR"
      Iteration2: TestSequenceScenario "UFR_Adjustment"
      Iteration3: TestSequenceScenario "UFR_Stop"

  case "UFR_Controller_SignalEditor" [baseline]
    model UFR_Controller, harness UFR_Controller_SE_Harness
    assessment "UFR_NoChange": At any point of time, whenever RelativeBloodVolume > UpperCriticalRBV is true then, with no delay, Cmd_FlowRate == Prescribed_FlowRate must be true
    assessment "UFR_Reducing": At any point of time, if RelativeBloodVolume < UpperCriticalRBV becomes true and stays true for at least 0.01 then, starting from end of min-time, with no delay, Cmd_FlowRate < Prescribed_FlowRate must be true
    assessment "Zero_UFR": At any point of time, if RelativeBloodVolume <= LowerCriticalRBV becomes true and stays true for at least 0.01 then, starting from rising edge of trigger, with no delay, Cmd_FlowRate == 0 must be true
    assessment "NonZero_UFR": At any point of time, whenever (RelativeBloodVolume > LowerCriticalRBV) & (RelativeBloodVolume < UpperCriticalRBV) is true then, with no delay, (Cmd_FlowRate ~= 0) & (Cmd_FlowRate < Prescribed_FlowRate) must be true
      RelativeBloodVolume: signal UFR_Controller_SE_Harness/Input Conversion Subsystem, port 2
      UpperCriticalRBV: signal UFR_Controller_SE_Harness/Input Conversion Subsystem, port 4
      Cmd_FlowRate: signal UFR_Controller_SE_Harness/Output Conversion Subsystem, port 1
      Prescribed_FlowRate: signal UFR_Controller_SE_Harness/Input Conversion Subsystem, port 1
      LowerCriticalRBV: signal UFR_Controller_SE_Harness/Input Conversion Subsystem, port 3

  case "Missing_Coverage_Test" [baseline] (disabled)
    model UFR_Controller, harness UFR_Controller_Harness1
    signal scenario: TestCase_1 (UFR_Controller_Harness1/Harness Inputs)
    iterations:
      Iteration1: SignalBuilderGroup "TestCase_1"