# Requirement set Hemodialysis_Requirements (R2023a)

## 1 [Hemodialysis_Requirements!Sheet1] References to Hemodialysis_Requirements.xlsx (Sheet1) (Container)
Read-only references to Microsoft Excel document.

### 1.1 [1] Architecture
This is software architecture requirements

### 1.2 [1.1] Command Inputs

### 1.3 [1.1.1] Patient Information
UI/Controller shall have the capability to enter patient information such as weight, BP, Age etc

### 1.4 [1.1.2] Plasma Refill Rate
UI shall have the way to define PPR as constant or some slope depending on patient's history

### 1.5 [1.2] Feedback Inputs

### 1.6 [1.2.1] Calculated UFR
Relative blood volume shall be calculated from calculated UFR and PPR

### 1.7 [2] Supervisory Logic/Controller
This is hemodialysis equipment controller requirements

### 1.8 [2.1] UFR monitoring system
Control system shall maintain mean UFR -- 0.17 +/- 0.06 ml/sec for longer sessions and 0.15 +/- 0.05 for shorter sessions

### 1.9 [2.2] Prevent Interdialytic Hypotension
Control system shall stop UFR when rate of change of relative blood volume changes below or above critical levels

### 1.10 [2.3] Interface
Control system shall receive precribed Ultrafiltration rate, relative blood volume as input from other subsystems

### 1.11 [3] Fault Detector

### 1.12 [3.1] No fluid removal
Control system shall detect and notify condition when plasma refill rate is same or faster than ultrafiltration rate

### 1.13 [3.2] Prevent patient mortality
Control system shall detect, notify and stop UF system when relative blood volume drops too rapidly (UF rate too fast than PPR) and drops below critical thresholds